% Simulink data dictionary GenDynamicDD.sldd

EV_current = 200
EV_motion = [20 4 0.8]
EV_sf = 2000
Fs = 0
Fv = 0.0025
Jcomp = 0.0227
Ki = 1.256637
Kisa = 346.6583
Kp_d = 0.6484247
Kp_q = 1.130973
Ksa = 85.4316
Ksf = 1996.2651
Ld = 0.000516
Ldq = [0.000516 0.0009]
Lq = 0.0009
Mechanical = [0.0227 0.0025 0]
P = 4
PolePairs = 4
Rs = 0.001
T_max = 247.5806
T_mtpa = [0 25.39472 50.97752 76.92559 103.3972 130.5276 158.4289 187.192 216.89 247.5811]
ba = 3.4029
id_mtpa = [-0 -1.170707 -4.615334 -10.14948 -17.51585 -26.43279 -36.63087 -47.87282 -59.95999 -72.73109]
idq0 = [0 0]
idq_limits = [-72.73237 198.4498 211.3583]
iq_mtpa = [0 23.45505 46.74119 69.71785 92.28953 114.4074 136.0608 157.2647 178.049 198.4503]
lambda_pm = 0.18
mechanical = [0.0227 0.0025 0]
omega_init = 0
theta_init = 0