% Simulink data dictionary GenMappedDD.sldd

EV_current = 200
EV_motion = [20 4 0.8]
EV_sf = 2000
Fs = 0
Fv = 0.0025
Jcomp = 0.0227
Ki = 251.3274
Kisa = 346.6583
Kp_d = 0.47149
Kp_q = 0.52125
Ksa = 85.4316
Ksf = 1996.2651
Ld = 0.0003752
Ldq = [0.0003752 0.0004148]
Lq = 0.0004148
Mechanical = [0.0227 0.0025 0]
P = 4
PolePairs = 4
Rs = 0.2
T_max = 120
T_mtpa = [0 13.31318 26.62788 39.94562 53.26789 66.59622 79.93211 93.27704 106.6325 120]
ba = 3.4029

gen = struct(
  max_trq=247.5806,
  max_pwr=102.1018,
  spd=[0 500 1000 1500 2000 2500 3000 3500 3938.111 4000 4500 5000 5500 6000 6500 7000 7500 8000 8500 9000 9500 10000 10500 11000 11500 12000 12500],
  trq=[247.5806 247.5806 247.5806 247.5806 247.5806 247.5806 247.5806 247.5806 247.5806 243.75 216.6667 195 177.2727 162.5 150 139.2857 130 121.875 114.7059 108.3333 102.6316 97.5 92.85714 88.63636 84.78261 81.25 78],
  trq_cp=[243.75 216.6667 195 177.2727 162.5 150 139.2857 130 121.875 114.7059 108.3333 102.6316 97.5 92.85714 88.63636 84.78261 81.25 78],
  J=0.02,
  damp=0.001,
  Tc=0.02,
  map=struct(
    spdindex=[0 1000 2000 3000 3857 4000 5000 6000 7000 8000 9000 10000 11000 12000 12584],
    trqindex=[10 25 50 75 100 125 150 175 200 225 235.2016],
    eff=[84 90 90 90 90 90 90 90 90 90 90 90 90 90 90
     84 90 93 95 95 95 96 95 95 95 95 93 93 93 93
     84 90 93 95 95 95 96 95 96 95 95 95 95 93 93
     84 90 93 95 95 95 96 96 96 95 95 93 95 93 93
     84 90 93 95 95 95 96 96 96 95 95 93 93 93 93
     84 88 90 93 93 95 95 96 95 93 93 93 93 93 93
     84 88 90 90 90 93 95 95 93 93 93 93 93 93 93
     84 88 90 90 90 90 93 93 93 93 93 93 93 93 93
     84 84 88 90 90 90 90 93 93 93 93 93 93 93 93
     84 84 88 90 90 90 90 93 93 93 93 93 93 93 93
     84 84 88 90 90 90 90 93 93 93 93 93 93 93 93]),
  m=20,
  Cp=200)

id_mtpa = [-0 -0.1145234 -0.4579891 -1.030085 -1.830291 -2.857884 -4.111939 -5.591333 -7.294754 -9.2207]
idq0 = [0 0]
idq_limits = [-9.2207 166.9935 167.2479]
iq_mtpa = [0 18.58274 37.16337 55.73977 74.30985 92.87152 111.4227 129.9615 148.4857 166.9935]
lambda_pm = 0.1194
mechanical = [0.0227 0.0025 0]
omega_init = 0
theta_init = 0