% Simulink data dictionary MotDynamicDD.sldd

EV_current = 200
EV_motion = [20 4 0.8]
EV_sf = 2000
Fs = 0
Fv = 0.0025
Jcomp = 0.0227
Ki = 1.256637
Kisa = 346.6583
Kp_d = 0.6484247
Kp_q = 1.130973
Ksa = 85.4316
Ksf = 1996.2651
Ld = 0.000516
Ldq = [0.000516 0.0009]
Lq = 0.0009
Mechanical = [0.0227 0.0025 0]
P = 4
PolePairs = 4
Rs = 0.001
T_max = 307
T_mtpa = [0 30.62105 61.56907 93.1445 125.6039 159.1549 193.9596 230.1425 267.7985 307]
ans = []
ba = 3.4029
id_mtpa = [-0 -1.696464 -6.646491 -14.48365 -24.73043 -36.90688 -50.59341 -65.45084 -81.21629 -97.69]
idq0 = [0 0]
idq_limits = [-97.6904 235.2349 254.7133]
iq_mtpa = [0 28.25058 56.21137 83.65994 110.4716 136.6097 162.0967 186.9863 211.3438 235.235]
lambda_pm = 0.18
mechanical = [0.0227 0.0025 0]
omega_init = 0
theta_init = 0