% Simulink data dictionary MotMappedDD.sldd

EV_current = 200
EV_motion = [20 4 0.8]
EV_sf = 2000
Fs = 0
Fv = 0.0025
Jcomp = 0.0227
Ki = 251.3274
Kisa = 346.6583
Kp_d = 0.47149
Kp_q = 0.52125
Ksa = 85.4316
Ksf = 1996.2651
Ld = 0.0003752
Ldq = [0.0003752 0.0004148]
Lq = 0.0004148
Mechanical = [0.0227 0.0025 0]
P = 4
PolePairs = 4
Rs = 0.2
T_max = 120
T_mtpa = [0 13.31318 26.62788 39.94562 53.26789 66.59622 79.93211 93.27704 106.6325 120]
ba = 3.4029
id_mtpa = [-0 -0.1145234 -0.4579891 -1.030085 -1.830291 -2.857884 -4.111939 -5.591333 -7.294754 -9.2207]
idq0 = [0 0]
idq_limits = [-9.2207 166.9935 167.2479]
iq_mtpa = [0 18.58274 37.16337 55.73977 74.30985 92.87152 111.4227 129.9615 148.4857 166.9935]
lambda_pm = 0.1194
mechanical = [0.0227 0.0025 0]

mot = struct(
  max_trq=307,
  max_pwr=124,
  spd=[0 500 1000 1500 2000 2500 3000 3500 3857.045 4000 4500 5000 5500 6000 6500 7000 7500 8000 8500 9000 9500 10000 10500 11000 11500 12000 12500],
  trq=[307 307 307 307 307 307 307 307 307 296.0282 263.1362 236.8226 215.2932 197.3521 182.1712 169.159 157.8817 148.0141 139.3074 131.5681 124.6435 118.4113 112.7726 107.6466 102.9663 98.67606 94.72902],
  trq_cp=[296.0282 263.1362 236.8226 215.2932 197.3521 182.1712 169.159 157.8817 148.0141 139.3074 131.5681 124.6435 118.4113 112.7726 107.6466 102.9663 98.67606 94.72902],
  J=0.02,
  damp=0.0001,
  Tc=0.0267,
  map=struct(
    spdindex=[0 1000 2000 3000 3857 4000 5000 6000 7000 8000 9000 10000 11000 12000 12584],
    trqindex=[10 25 50 75 100 125 150 175 200 225 250 275 300 307],
    eff=[84 90 90 90 90 90 90 90 90 90 90 90 90 90 90
     84 90 93 95 95 95 96 95 95 95 95 93 93 93 93
     84 90 93 95 95 95 96 95 96 95 95 95 95 93 93
     84 90 93 95 95 95 96 96 96 95 95 95 95 93 93
     84 90 93 95 95 95 96 96 96 95 95 93 93 93 90
     84 88 90 93 93 95 95 96 95 95 95 93 93 93 90
     84 88 90 90 90 93 95 95 95 93 93 93 93 93 90
     84 88 90 90 90 90 93 93 93 93 93 93 93 93 90
     84 84 88 90 90 90 93 93 93 93 93 93 93 93 90
     84 84 88 90 90 90 90 93 93 93 93 93 93 93 90
     84 84 84 90 90 90 90 93 93 93 93 93 93 93 90
     84 84 84 88 90 90 90 93 93 93 93 93 93 93 90
     84 84 84 88 88 88 90 93 93 93 93 93 93 93 90
     84 84 84 88 88 88 90 93 93 93 93 93 93 93 90]),
  m=30,
  Cp=200)

omega_init = 0
theta_init = 0